vi "802.11 Host.gvi"   [LabVIEW Communications System Design Suite 2.0.1]
# Queues pseudorandom number data to send the queue at the specified packet rate. The node ensures that the average packet rate is met even if it is not called in a regular time interval.
panel controls:
  "Trigger TX": bool
  "Clear events": bool
  "Operation Mode": T2 = "RF Loopback"
  "Primary Subband": UFXP(2.0) = 1
  "Transmit IP Address": string = "127.0.0.1"
  "Transmit Port": u16 = 12346
  "Receive Port": u16 = 12345
  "Tab": i32
  "Power Level [dBm]": f64
  "TX Frequency [Hz]": f64 = 2437000000
  "Destination MAC Address": u8[6] = [71, 111, 75, 117, 109, 98]
  "Device MAC Address": u8[6] = [71, 111, 75, 117, 109, 97]
  "TX Port (USRP only)": enum{"TX1/RF 0", "TX1/RF 1"} = "TX1/RF 0"
  "RX Port (USRP only)": T3 = "RX2/RF 1"
  "AGC": bool = TRUE
  "Manual RX gain [dB]": f64 = 37.5
  "PN Data Packet Size": i32 = 1024
  "Subcarrier Format": i32 = "20 MHz (IEEE 802.11 a)"(0)
  "Stop": bool
  "RIO Device": string = "RIO0"
  "Station": bool
  "reset TX staistics": bool
  "reset RX staistics": bool
  "PN Packets per Second": u32 = 1000
  "Transmit ACK": bool = TRUE
  "Backoff": u16 = 4
  "All": bool
  "None": bool
  "Events to Track": T5
  "CCA Energy Detection Threshold [dBm]": FXP(10.3) = -72
  "MCS": UFXP(4.0) = 4
  "session": "802.11 Host Session.gtype"
  "Data Source Option": i32 = 1
  "Data Sink Options": i32
  "Data Source": enum{"UDP", "PN Data", "Manual", "Multi-stream"} = "PN Data"
  "Data Sink": enum{"Off", "UDP"} = "Off"
  "Reference Clock": string = "Internal"
  "USRP bandwidth": "USRP bandwidth.gtype" = "40 MHz"
  "PN Data Packet Size_1": i32 = 1024
  "PN Packets per Second_1": u32 = 1000
  "PN Data Packet Size_2": i32 = 1024
  "PN Packets per Second_2": u32 = 1000
  "PN Data Packet Size_3": i32 = 1024
  "PN Packets per Second_3": u32 = 1000
  "PN Data Packet Size_4": i32 = 1024
  "PN Packets per Second_4": u32 = 1000
  "PN Data Packet Size_5": i32 = 1024
  "PN Packets per Second_5": u32 = 1000
panel indicators:
  "Events": string
  "MAC TX Statistic": T1
  "Baseband Power": f64
  "Coerced LO frequency TX [Hz]": f64
  "Coerced LO frequency RX [Hz]": f64
  "Channel Estimation": cluster{"Element 1": i32[], "Element 2": f64[]}[]
  "TX Block Error Rate": f64
  "Coerced Power Level [dBm]": f64
  "RX Throughput": f64
  "Applied RX Gain [dB]": f64
  "RX Throughput [bits/s]": f64
  "Current TX Block Error Rate (BLER)": f64
  "RX Frequency [Hz]": f64
  "Overwritten by Device MAC Address": bool
  "Station Active": bool
  "Device Ready": bool
  "Baseband RX Power [dBFS]": f64
  "RX Constellation": c128[]
  "RX Power Spectrum": T4
  "TX Power Spectrum": T4
  "Data Transfer": bool
  "FIFO Full": bool
  "FIFO Full": bool
  "Data Transfer": bool
  "Compensated CFO [Hz]": f64
  "TX Data Dropped": bool
  "modulation and coding rate": string
  "MAC RX Statistic": T10
  "Target FIFO Overflow": bool
  "RF Input Power": f64[][]
types:
  T1 = cluster{"TX after SIFS Requests Detected": u32, "TX after SIFS Requests Completed": u32, "TX after Backoff Requests Detected": u32, "TX after Backoff Requests Completed": u32}
  T2 = enum{"Baseband Loopback", "RF Loopback", "RF Multi Station"}
  T3 = enum{"RX1/RF 0", "RX2/RF 0", "RX1/RF 1", "RX2/RF 1"}
  T4 = cluster{"f0": f64, "df": f64, "magnitude": f64[]}
  T5 = cluster{"PhyTxStart": bool, "PhyTxEnd": bool, "PhyRxStart": bool, "PhyRxEnd": bool, "MacChannelState": bool, "MacTxStatus": bool, "PhyCcaTiming": bool, "PhyCcaTiming_2": bool, "PhyCcaTiming_3": bool}
  T6 = cluster{"Timestamp": u32, "Transferred Bytes": u32}
  T7 = cluster{"fpga ref": any, "bus instance": u32, "instruction FIFO depth": u32, "executing on FPGA target": bool, "show error call chain": bool}
  T8 = cluster{"Actual Gain [dB]": f64, "Attenuation Table Index": i32}
  T9 = cluster{"Attenuation Table [dB]": f64[][], "Frequencies [Hz]": f64[], "IQ Imbalance Table": "niUsrpRio Config v1 Host.lvlib__IQ Imbalance.gtype"[], "Gain Table": T8[][]}
  "niInstr Register Bus v0 Host.lvlib__Register Bus Session.gtype" = Queue<"niInstr Register Bus v0 Host.lvlib__Session Data.gtype">
  "Semaphore RefNum.gtype" = i32
  "niUsrpRio Config v1 Host.lvlib__DB Queue Reference.gtype" = Queue<"niUsrpRio Config v1 Host.lvlib__Daughterboard Data.gtype">
  "niUsrpRio Config v1 Host.lvlib__niUsrpRio Session.gtype" = cluster{"FPGA Interface": any, "RIO Interface Number": u32, "Data Clock Rate": u32, "FPGA Data Clock Rate": u32, "Global Settings Register Bus": "niInstr Register Bus v0 Host.lvlib__Register Bus Session.gtype", "Radio 0 Settings Register Bus": "niInstr Register Bus v0 Host.lvlib__Register Bus Session.gtype", "Radio 1 Settings Register Bus": "niInstr Register Bus v0 Host.lvlib__Register Bus Session.gtype", "Radio Settings Bus Semaphore": "Semaphore RefNum.gtype", "DB Queues": "niUsrpRio Config v1 Host.lvlib__DB Queue Reference.gtype"[], "Characterization Data Valid?": bool, "EEPROM Header": "niUsrpRio Config v1 Host.lvlib__EEPROM Header.gtype", "Device Data Header": "niUsrpRio Config v1 Host.lvlib__EEPROM Device Data Header.gtype", "EEPROM Characterization Header": "niUsrpRio Config v1 Host.lvlib__EEPROM Characterization Header.gtype", "Characterization Data": "niUsrpRio Config v1 Host.lvlib__Characterization Data.gtype"[], "FPGA Current Version": u32, "FPGA Oldest Compatible Version": u32, "Fixed Logic Current Version": u32, "Fixed Logic Oldest Compatible Version": u32, "FPGA Radio Settings Bus Current Version": u32, "FPGA Radio Settings Bus Oldest Compatible Version": u32, "FPGA Board Config Current Version": u32, "FPGA Board Config Oldest Compatible Version": u32, "Daughterboard Clock Rate": u32}
  "802.11 Host Session.gtype" = cluster{"FPGA interface": "802.11 FGPA Reference.gtype", "send queue": Queue<u8[]>, "receive queue": Queue<u8[]>, "receive throughput queue": Queue<T6>, "UDP Receiver": UdpNetworkConnectionRefnum, "PN packet": u8[], "FlexRIO session": Queue<T7>, "FlexRIO TX Characterization Data": T9, "FlexRIO RX Characterization Data": T9, "USRP session": "niUsrpRio Config v1 Host.lvlib__niUsrpRio Session.gtype", "RF loop clock frequency": f64}
  T10 = cluster{"Packet Starts detected": u32, "Frames from PHY": u32, "Frames with FCS pass": u32, "ACKs Received": u32}
  "USRP bandwidth.gtype" = enum{"40 MHz", "120 MHz", "160 MHz"}
  T11 = cluster{"TX after SIFS requests detected": u32, "TX after SIFS requests completed": u32, "TX after backoff requests detected": u32, "TX after backoff requests completed": u32}
  T12 = cluster{"Frames detected": u32, "Subframes received": u32, "Valid subframes received": u32, "ACKs received": u32}
  T13 = cluster{"PhyTxStart": bool, "PhyTxEnd": bool, "PhyRxStart": bool, "PhyRxEnd": bool, "MacChannelState": bool, "MacTxStatus": bool, "PhyCcaTiming": bool, "PhyRxGainChange": bool, "PhyRxAGCStateChange": bool}
  T14 = cluster{"remove header": bool, "block unsupported frame types": bool, "block FCS errors": bool, "block address mismatch": bool, "block header recognize error": bool}
diagram:
  sequence {
    frame 0 {
      $Events <- EmptyString
      $"Device Ready" <- FALSE
      $"Station Active" <- FALSE
      $Station <- FALSE
      $"RX Constellation" <- c128[] []
      $"RX Power Spectrum" <- T4 {all zero or empty}
      $"TX Power Spectrum" <- T4 {all zero or empty}
      $"Channel Estimation" <- cluster{"Element 1": i32[], "Element 2": f64[]}[] []
      $"MAC TX Statistic" <- T11 {all zero or empty}
      $"MAC RX Statistic" <- T12 {all zero or empty}
      $"Current TX Block Error Rate (BLER)" <- 0
      $"RX Throughput [bits/s]" <- 0
      $"Compensated CFO [Hz]" <- 0
      for (N = 51) {
        $"RX Throughput" <- NaN
        $"TX Block Error Rate" <- NaN
        $"Baseband Power" <- NaN
      }
      Initialize Array(element=NaN, size=51, size=2) -> w1
      $"RF Input Power" <- w1
    }
  }
  call "Create Stop Notifier.gvi"(error in=no error) -> (error out=w2)
  call "802.11 Host Init.gvi"(device=$"RIO Device", error in=w2, reference clock=$"Reference Clock", USRP bandwidth=$"USRP bandwidth") -> (session out=w3, error out=w4)
  # 2017/08/18 Yue
  # These session contains five parts of send queue.
  case (w4) {
    frame Error {
      w5 = w4
    }
    frame No Error {
      $"Device Ready" <- TRUE
      $session <- w3
      w5 = w4
    }
  }
  s1 = w5  # shift register
  while {
    # RX Reception
    call "802.11 Unbundle Session.gvi"(session=$session) -> (FPGA interface=w6, receive queue=w7, receive throughput queue=w8)
    call "802.11 Receive RX ICP.gvi"(FPGA interface=w6, error in=s1, receive queue=w7, receive throughput queue=w8, enqueue decoded data=$"Station Active") -> (error out=w9)
    call "Check Stop.gvi"(error in=w9) -> (error out=w10, stop=w11)
    Wait Until Next Multiple(multiple to wait=0)
    next s1 = w10
    stop if w11
  }
  call "Stop On Error.gvi"(error in=s1) -> (error out=w12)
  s2 = w5  # shift register
  s3 = string[] []  # shift register
  while {
    call "802.11 Unbundle Session.gvi"(session=$session) -> (FPGA interface=w13)
    call "802.11 Prepare Constellation.gvi"(FPGA interface=w13, error in=s2, maximal number of subcarriers=4800) -> (error out=w14, data field constellation=w15, update constellation=w16)
    # update plots and indicators (slow)
    Logical And($"Station Active", w16) -> w17
    case (w17) {
      frame False { }
      frame True {
        $"RX Constellation" <- w15
      }
    }
    call "802.11 Read Event FIFO.gvi"(FPGA interface=w13, error in=s2) -> (raw events=w18, error out=w19)
    call "802.11 Prepare RX Power Spectrum.gvi"(FPGA interface=w13, error in=s2) -> (error out=w20, RX power spectrum=w21, update power spectrum=w22)
    call "802.11 Prepare TX Power Spectrum.gvi"(FPGA interface=w13, error in=s2) -> (error out=w23, TX power spectrum=w24, update power spectrum=w25)
    call "802.11 Prepare Channel Estimation.gvi"(FPGA interface=w13, error in=s2, channel subband=$"Primary Subband", subcarrier format=$"Subcarrier Format") -> (error out=w26, channel estimation=w27, update power spectrum=w28)
    call "802.11 Read Target Registers.gvi"(FPGA interface=w13, error in=s2) -> (error out=w29, target FIFO overflow=w30, compensated CFO=w31, RF input power=w32, MAC RX statistics=w33, MAC TX statistics=w34, signal power at packet start=w35)
    Merge Errors(w14, w20, w23, w26, w29, w19) -> (error out=w36)
    call "Check Stop.gvi"(error in=w36) -> (error out=w37, stop=w38)
    Logical And($"Station Active", w22) -> w39
    case (w39) {
      frame False, Default { }
      frame True {
        $"RX Power Spectrum" <- w21
      }
    }
    Logical And($"Station Active", w25) -> w40
    case (w40) {
      frame False, Default { }
      frame True {
        $"TX Power Spectrum" <- w24
      }
    }
    Logical And($"Station Active", w28) -> w41
    case (w41) {
      frame False, Default { }
      frame True {
        $"Channel Estimation" <- w27
      }
    }
    $"Target FIFO Overflow" <- w30
    $"Compensated CFO [Hz]" <- w31
    $"RF Input Power" <- w32
    $"Baseband Power" <- w35
    $"MAC RX Statistic" <- w33
    $"MAC TX Statistic" <- w34
    call "802.11 Events to String.gvi"(event data=w18, events to track=$"Events to Track") -> (event strings=w42)
    for {
      w43 = each element of w42
      Match Pattern(regular expression="PhyRxStart.ind ", string=w43) -> (offset past match=w45)
      Is Not Equal(x=w45, y=-1) -> w46
      append w46 to w44
    }
    Or Array Elements(Boolean array=w44)
    w47 = -12  # CFX data type offset
    Add(w35, w47) -> w48
    $"Baseband RX Power [dBFS]" <- w48
    Build Array[ConcatenateInputs=True](s3, w42) -> w49
    Delete From Array(inArray=w49, length (1)=10000) -> (deleted=w50)
    Select(s=$"Clear events", t=string[] [], f=w50) -> w51
    Concatenate Strings(w50) -> w52
    $Events <- w52
    Select(s=$None, t=T13 {all zero or empty}, f=$"Events to Track") -> w53
    w54 = T13 {"PhyTxStart"=TRUE, "PhyTxEnd"=TRUE, "PhyRxStart"=TRUE, "PhyRxEnd"=TRUE, "MacChannelState"=TRUE, "MacTxStatus"=TRUE, "PhyCcaTiming"=TRUE, "PhyRxGainChange"=TRUE, "PhyRxAGCStateChange"=TRUE}
    Select(s=$All, t=w54, f=w53) -> w55
    $"Events to Track" <- w55
    Wait Until Next Multiple(multiple to wait=250)
    next s2 = w37
    next s3 = w51
    stop if w38
  }
  call "Stop On Error.gvi"(error in=s2) -> (error out=w56)
  s4 = w5  # shift register
  while {
    Feedback Node(input=$"Station Active") -> w57
    Is Not Equal(x=$"Station Active", y=w57) -> w58
    # update plots and indicators (fast)
    case ($"Station Active") {
      frame False, Default {
        w59 = s4
      }
      frame True {
        call "802.11 Unbundle Session.gvi"(session=$session) -> (FPGA interface=w60, receive throughput queue=w61)
        call "802.11 Prepare Throughput Measurements.gvi"(reset=w58, FPGA interface=w60, receive throughput queue=w61, error in=s4, timing granularity=100) -> (error out=w59, TX block error rate=w62, RX throughput=w63)
        $"Current TX Block Error Rate (BLER)" <- w62
        $"TX Block Error Rate" <- w62
        $"RX Throughput [bits/s]" <- w63
        Divide(x=w63, y=1000000) -> w64
        $"RX Throughput" <- w64
      }
    }
    call "Check Stop.gvi"(error in=w59) -> (error out=w65, stop=w66)
    Wait Until Next Multiple(multiple to wait=100)
    next s4 = w65
    stop if w66
  }
  call "Stop On Error.gvi"(error in=s4) -> (error out=w67)
  Udp Open(error in=w5, net address=0, port=0, service name="", timeout ms=25000) -> (connection ID=w68, error out=w69)
  call "Set Socket Option.gvi"(connection in=w68, level=0xFFFF, option name=0x1001, value=1024000, error in=w69) -> (error out=w70, connection out=w71)
  s5 = w70  # shift register
  s6 = w71  # shift register
  while {
    call "802.11 Unbundle Session.gvi"(session=$session) -> (send queue_1=w72, send queue_5=w73, receive queue=w74, send queue_2=w75, UDP receiver=w76, PN packet=w77, send queue_3=w78, send queue_4=w79)
    # UDP send and receive
    case ($"Station Active") {
      frame False, Default {
        w80 = s5
        w81 = s6
      }
      frame True {
        # 2017/08/18 Yue
        # when we use the data source as PN data/
        # UDP/Manual, only use the send quene_1
        Array Subset(array=w77, length0=$"PN Data Packet Size_1") -> w82
        Array Subset(array=w77, length0=$"PN Data Packet Size_2") -> w83
        Array Subset(array=w77, length0=$"PN Data Packet Size_3") -> w84
        Array Subset(array=w77, length0=$"PN Data Packet Size_4") -> w85
        Array Subset(array=w77, length0=$"PN Data Packet Size_5") -> w86
        Array Subset(array=w77, length0=$"PN Data Packet Size") -> w87
        case ($"Data Source") {
          frame "UDP" {
            # UDP
            call "802.11 Receive UDP Data.gvi"(UDP receiver=w76, send queue=w72, error in=s5) -> (data transfer=w89, error out=w88, FIFO full=w94)
            $"FIFO Full" <- w94
            w90 = default
            w91 = default
            w92 = default
            w93 = default
          }
          frame "PN Data" {
            # PN data
            call "802.11 Send PN Data.gvi"(PN packets per second=$"PN Packets per Second", send queue=w72, PN data=w87, error in=s5) -> (data transfer=w89, error out=w88)
            w90 = default
            w91 = default
            w92 = default
            w93 = default
          }
          frame "Manual", Default {
            # Manual
            case ($"Trigger TX") {
              frame False, Default {
                w88 = s5
                w89 = $"Trigger TX"
              }
              frame True {
                Enqueue Element(element=w87, error in=s5, queue=w72, timeout in ms=-1) -> (error out=w88, queue out=w95)
                w89 = $"Trigger TX"
              }
            }
            w90 = default
            w91 = default
            w92 = default
            w93 = default
          }
          frame "Multi-stream" {
            case ($"Data Source") {
              frame "UDP", Default {
                w88 = s5
                w89 = FALSE
              }
              frame "PN Data" {
                # PN data
                call "802.11 Send PN Data.gvi"(PN packets per second=$"PN Packets per Second_1", send queue=w72, PN data=w82, error in=s5) -> (data transfer=w89, error out=w88)
              }
            }
            case ($"Data Source") {
              frame "UDP", Default {
                w90 = s5
              }
              frame "PN Data" {
                # PN data
                call "802.11 Send PN Data.gvi"(PN packets per second=$"PN Packets per Second_2", send queue=w75, PN data=w83, error in=s5) -> (error out=w90)
              }
            }
            case ($"Data Source") {
              frame "UDP", Default {
                w91 = s5
              }
              frame "PN Data" {
                # PN data
                call "802.11 Send PN Data.gvi"(PN packets per second=$"PN Packets per Second_3", send queue=w78, PN data=w84, error in=s5) -> (error out=w91)
              }
            }
            case ($"Data Source") {
              frame "UDP", Default {
                w92 = s5
              }
              frame "PN Data" {
                # PN data
                call "802.11 Send PN Data.gvi"(PN packets per second=$"PN Packets per Second_4", send queue=w79, PN data=w85, error in=s5) -> (error out=w92)
              }
            }
            case ($"Data Source") {
              frame "UDP", Default {
                w93 = s5
              }
              frame "PN Data" {
                # PN data
                call "802.11 Send PN Data.gvi"(PN packets per second=$"PN Packets per Second_5", send queue=w73, PN data=w86, error in=s5) -> (error out=w93)
              }
            }
          }
        }
        $"Data Transfer" <- w89
        Is Equal(x=$"Data Sink", y="UDP") -> w96
        call "802.11 Send UDP Data.gvi"(target port=$"Transmit Port", target IP address=$"Transmit IP Address", receive queue=w74, UDP sender=s6, enable=w96, error in=s5) -> (FIFO full=w97, error out=w98, UDP sender dup=w81, data transfer=w99)
        Merge Errors(w88, w90, w91, w92, w93, w98) -> (error out=w80)
        $"Data Transfer" <- w99
        $"FIFO Full" <- w97
      }
    }
    call "Check Stop.gvi"(error in=w80) -> (error out=w100, stop=w101)
    Wait Until Next Multiple(multiple to wait=0)
    next s5 = w100
    next s6 = w81
    stop if w101
  }
  call "Stop On Error.gvi"(error in=s5) -> (error out=w102)
  Udp Close(connection ID=s6, error in=w102) -> (error out=w103)
  s7 = w5  # shift register
  while {
    call "802.11 Unbundle Session.gvi"(session=$session) -> (FPGA interface=w104, send queue_1=w105, send queue_5=w106, send queue_2=w107, send queue_3=w108, send queue_4=w109)
    w110 = $"Device MAC Address"
    w111 = $"Operation Mode"
    w112 = $"Destination MAC Address"
    w113 = $"Subcarrier Format"
    # 2017/08/18 Yue
    # The only different between the input of these
    # five steams is the different payload, it is
    # from different queues.
    # TX transmission
    w114 = $MCS
    w115 = $"Station Active"
    while {
      Dequeue Element(error in=s7, queue=w107, timeout in ms=0) -> (element=w116, error out=w117, timed out?=w118)
      Logical And(w115, not w118) -> w119
      case (w119) {
        frame False {
          w120 = w117
          w121 = default
          w122 = default
        }
        frame True {
          call "802.11 Subcarrier Format to Configuration.gvi"(MCS=w114, subcarrier format=w113, error in=w117) -> (error out=w123, format=w124, bandwidth=w125, valid configuration=w126)
          Is Not Equal(x=w111, y="RF Multi Station") -> w122
          Select(s=w122, t=w110, f=w112) -> w127
          case (w126) {
            frame False, Default {
              w121 = FALSE
              w120 = w123
            }
            frame True {
              call "802.11 Send TX ICP_2.gvi"(FPGA interface=w104, MCS=w114, device MAC address=w110, error in=w123, destination MAC address=w127, payload=w116, format=w124, bandwidth=w125) -> (dropped?=w121, error out=w120)
            }
          }
        }
      }
      call "Check Stop.gvi"(error in=w120) -> (error out=w128, stop=w129)
      Logical Or(w129, w118) -> w130
      stop if w130
    }
    while {
      Dequeue Element(error in=s7, queue=w108, timeout in ms=0) -> (element=w131, error out=w132, timed out?=w133)
      Logical And(w115, not w133) -> w134
      case (w134) {
        frame False {
          w135 = w132
          w136 = default
          w137 = default
        }
        frame True {
          call "802.11 Subcarrier Format to Configuration.gvi"(MCS=w114, subcarrier format=w113, error in=w132) -> (error out=w138, format=w139, bandwidth=w140, valid configuration=w141)
          Is Not Equal(x=w111, y="RF Multi Station") -> w137
          Select(s=w137, t=w110, f=w112) -> w142
          case (w141) {
            frame False, Default {
              w136 = FALSE
              w135 = w138
            }
            frame True {
              call "802.11 Send TX ICP_3.gvi"(FPGA interface=w104, MCS=w114, device MAC address=w110, error in=w138, destination MAC address=w142, payload=w131, format=w139, bandwidth=w140) -> (dropped?=w136, error out=w135)
            }
          }
        }
      }
      call "Check Stop.gvi"(error in=w135) -> (error out=w143, stop=w144)
      Logical Or(w144, w133) -> w145
      stop if w145
    }
    while {
      Dequeue Element(error in=s7, queue=w109, timeout in ms=0) -> (element=w146, error out=w147, timed out?=w148)
      Logical And(w115, not w148) -> w149
      case (w149) {
        frame False {
          w150 = w147
          w151 = default
          w152 = default
        }
        frame True {
          call "802.11 Subcarrier Format to Configuration.gvi"(MCS=w114, subcarrier format=w113, error in=w147) -> (error out=w153, format=w154, bandwidth=w155, valid configuration=w156)
          Is Not Equal(x=w111, y="RF Multi Station") -> w152
          Select(s=w152, t=w110, f=w112) -> w157
          case (w156) {
            frame False, Default {
              w151 = FALSE
              w150 = w153
            }
            frame True {
              call "802.11 Send TX ICP_4.gvi"(FPGA interface=w104, MCS=w114, device MAC address=w110, error in=w153, destination MAC address=w157, payload=w146, format=w154, bandwidth=w155) -> (dropped?=w151, error out=w150)
            }
          }
        }
      }
      call "Check Stop.gvi"(error in=w150) -> (error out=w158, stop=w159)
      Logical Or(w159, w148) -> w160
      stop if w160
    }
    while {
      Dequeue Element(error in=s7, queue=w106, timeout in ms=0) -> (element=w161, error out=w162, timed out?=w163)
      Logical And(w115, not w163) -> w164
      case (w164) {
        frame False {
          w165 = w162
          w166 = default
          w167 = default
        }
        frame True {
          call "802.11 Subcarrier Format to Configuration.gvi"(MCS=w114, subcarrier format=w113, error in=w162) -> (error out=w168, format=w169, bandwidth=w170, valid configuration=w171)
          Is Not Equal(x=w111, y="RF Multi Station") -> w167
          Select(s=w167, t=w110, f=w112) -> w172
          case (w171) {
            frame False, Default {
              w166 = FALSE
              w165 = w168
            }
            frame True {
              call "802.11 Send TX ICP_5.gvi"(FPGA interface=w104, MCS=w114, device MAC address=w110, error in=w168, destination MAC address=w172, payload=w161, format=w169, bandwidth=w170) -> (dropped?=w166, error out=w165)
            }
          }
        }
      }
      call "Check Stop.gvi"(error in=w165) -> (error out=w173, stop=w174)
      Logical Or(w174, w163) -> w175
      stop if w175
    }
    # 2017/08/18  Yue
    # need to point the write FIFO to RX
    while {
      Dequeue Element(error in=s7, queue=w105, timeout in ms=0) -> (element=w176, error out=w177, timed out?=w178)
      Logical And(w115, not w178) -> w179
      case (w179) {
        frame False {
          w180 = w177
          w181 = default
          w182 = default
        }
        frame True {
          call "802.11 Subcarrier Format to Configuration.gvi"(MCS=w114, subcarrier format=w113, error in=w177) -> (error out=w183, format=w184, bandwidth=w185, valid configuration=w186)
          Is Not Equal(x=w111, y="RF Multi Station") -> w182
          Select(s=w182, t=w110, f=w112) -> w187
          case (w186) {
            frame False, Default {
              w181 = FALSE
              w180 = w183
            }
            frame True {
              call "802.11 Send TX ICP.gvi"(FPGA interface=w104, MCS=w114, device MAC address=w110, error in=w183, destination MAC address=w187, payload=w176, format=w184, bandwidth=w185) -> (dropped?=w181, error out=w180)
            }
          }
        }
      }
      call "Check Stop.gvi"(error in=w180) -> (error out=w188, stop=w189)
      Logical Or(w189, w178) -> w190
      stop if w190
    }
    Merge Errors(w188, w128, w143, w158, w173) -> (error out=w191)
    call "Check Stop.gvi"(error in=w191) -> (error out=w192, stop=w193)
    Logical And(w181, w121, w136, w151, w166) -> w194
    $"TX Data Dropped" <- w194
    Logical And(w182, w122, w137, w152, w167) -> w195
    $"Overwritten by Device MAC Address" <- w195
    Wait Until Next Multiple(multiple to wait=0)
    next s7 = w192
    stop if w193
  }
  call "Stop On Error.gvi"(error in=s7) -> (error out=w196)
  s8 = w5  # shift register
  while {
    # configuration
    call "802.11 Unbundle Session.gvi"(session=$session) -> (FPGA interface=w197)
    Feedback Node(input=$"Station Active") -> w198
    case ($"Station Active") {
      frame False, Default {
        w199 = s8
      }
      frame True {
        Is Not Equal(x=$"Station Active", y=w198) -> w200
        call "802.11 Gain Control.gvi"(initialize=w200, RX Port (USRP only)=$"RX Port (USRP only)", session=$session, AGC=$AGC, error in=s8, Manual RX gain [dB]=$"Manual RX gain [dB]", RX Frequency [Hz]=$"RX Frequency [Hz]", TX Port (USRP only)=$"TX Port (USRP only)") -> (Applied RX Gain [dB]=w201, error out=w202)
        $"Applied RX Gain [dB]" <- w201
        call "802.11 Subcarrier Format to Configuration.gvi"(MCS=$MCS, subcarrier format=$"Subcarrier Format", error in=s8) -> (error out=w203, format=w204)
        call "802.11 Configure Dynamic Parameters.gvi"(FPGA interface=w197, error in=w203, format=w204, transmit ACK=$"Transmit ACK", backoff value=$Backoff, CCA energy detection threshold=$"CCA Energy Detection Threshold [dBm]") -> (error out=w205)
        Merge Errors(w202, w205) -> (error out=w199)
      }
    }
    w206 = $Station
    Feedback Node(input=w206) -> w207
    Logical Exclusive Or(w206, w207) -> w208
    case (w208) {
      frame False, Default {
        w209 = s8
      }
      frame True {
        case (w206) {
          frame False, Default {
            sequence {
              frame 0 {
                $"Station Active" <- w206
              }
            }
            call "802.11 Unbundle Session.gvi"(session=$session) -> (UDP receiver=w210)
            Udp Close(connection ID=w210, error in=s8) -> (error out=w211)
            call "Clear Errors.gvi"(specific error code to clear=1, error in=w211) -> (error out=w212)
            call "802.11 Abort RF Streams.gvi"(session=$session, error in=w212) -> (error out=w209)
          }
          frame True {
            $"RX Frequency [Hz]" <- $"TX Frequency [Hz]"
            call "802.11 FPGA Target Configuration.gvi"() -> (maximum gain=w213, enable DC offset correction=w214)
            w215 = T14 {"remove header"=TRUE, "block unsupported frame types"=TRUE, "block FCS errors"=TRUE, "block address mismatch"=TRUE, "block header recognize error"=TRUE}
            call "802.11 Configure Static Parameters.gvi"(session in=$session, error in=s8, primary subband=$"Primary Subband", operation mode=$"Operation Mode", enable DC offset correction=w214, MPDU filter configuration=w215, device MAC address=$"Device MAC Address") -> (session dup=w216, error out=w217)
            call "802.11 Reset Statistics.gvi"(session in=w216, error in=w217, reset RX statistics=TRUE, reset TX statistics=TRUE) -> (error out=w218, session dup=w219)
            call "802.11 Configure TX RF.gvi"(TX port=$"TX Port (USRP only)", session=w219, TX frequency=$"TX Frequency [Hz]", TX power level=$"Power Level [dBm]", error in=w218) -> (session dup=w220, error out=w221, coerced TX power level=w222, coerced LO frequency=w223)
            call "802.11 Configure RX RF.gvi"(RX frequency=$"TX Frequency [Hz]", session=w220, RX gain=w213, error in=w221, RX port=$"RX Port (USRP only)") -> (error out=w224, session dup=w225, coerced RX gain=w226, coerced LO frequency=w227)
            call "802.11 Configure AGC Registers.gvi"(TX Port=$"TX Port (USRP only)", enable AGC=FALSE, session=w225, RX port=$"RX Port (USRP only)", error in=w224) -> (error out=w228, session dup=w229)
            call "802.11 Set Power Calibration Offset.gvi"(session=w229, frequency=$"TX Frequency [Hz]", error in=w228, RX port=$"RX Port (USRP only)") -> (session dup=w230, error out=w231)
            call "802.11 Configure RF Streams.gvi"(TX port=$"TX Port (USRP only)", RX port=$"RX Port (USRP only)", session=w230, error in=w231) -> (session dup=w232, error out=w233)
            call "802.11 Configure Data Source.gvi"(error in=w233, receive port=$"Receive Port", session in=w232) -> (error out=w209, session out=w234, success?=w235)
            $session <- w234
            sequence {
              frame 0 {
                $Station <- w235
                $"Station Active" <- w206
              }
            }
            $"Coerced LO frequency RX [Hz]" <- w227
            $"Applied RX Gain [dB]" <- w226
            $"Coerced LO frequency TX [Hz]" <- w223
            $"Coerced Power Level [dBm]" <- w222
          }
        }
      }
    }
    call "802.11 Reset Statistics.gvi"(session in=$session, error in=s8, reset RX statistics=$"reset RX staistics", reset TX statistics=$"reset TX staistics") -> (error out=w236)
    call "802.11 Subcarrier Format to Configuration.gvi"(MCS=$MCS, subcarrier format=$"Subcarrier Format", error in=w236) -> (modulation and coding rate=w237, error out=w238)
    Merge Errors(w199, w209, w238) -> (error out=w239)
    call "Create Stop.gvi"(error in=w239, stop in=$Stop) -> (error out=w240)
    call "Check Stop.gvi"(error in=w240) -> (error out=w241, stop=w242)
    Wait Until Next Multiple(multiple to wait=100)
    $"modulation and coding rate" <- w237
    next s8 = w241
    stop if w242
  }
  call "Stop On Error.gvi"(error in=s8) -> (error out=w243)
  Merge Errors(w243, w196, w12, w103, w56, w67) -> (error out=w244)
  sequence {
    frame 0 {
      w245 = $session
    }
  }
  call "802.11 Host Release.gvi"(session=w245, error in=w244) -> (error out=w246)
  call "Simple Error Handler.gvi"(type of dialog="OK message", error in=w246)
