vi "802.11 FPGA STA.gvi"   [LabVIEW Communications System Design Suite 2.0.1]
panel controls:
  "reg.host read.go rcvd 0": bool
  "reg.notify host.go rcvd 0": bool
  "reg.reset 0": bool
  "RF 0/Rx/Enable": bool
  "RF 0/Tx/Enable": bool
  "RF 1/Rx/Enable": bool
  "RF 1/Tx/Enable": bool
  "ATR State": enum{"Idle", "Rx", "Tx", "Duplex"} = "Idle"
  "Radio Control Destination": T1 = "Radio 0 Config"
  "lo lpf enable": bool
  "power enable": bool
  "mixer enable": bool
  "tx.configuration": T2 = {"power enable"=TRUE, "mixer enable"=TRUE, "gain"=0}
  "RX data source": T3 = "RF"
  "packet start sample index": u16
  "rearm packet start generator": bool
  "bypass synchronization": bool
  "reset MAC RX statistics": bool
  "noise coefficient": FXP(8.8) = 10
  "mute RX while TX active?": bool = TRUE
  "number of samples to capture": u16 = 1024
  "produce silent samples": bool
  "MPDU filter config": T7 = {"remove header"=TRUE, "block unsupported frame types"=TRUE, "block FCS errors"=TRUE, "block address mismatch"=TRUE, "block header recognize error"=TRUE}
  "power calibration offset": FXP(10.3)
  "CCA energy detect threshold": FXP(10.3) = -62
  "RF gain": FXP(10.3)
  "number of samples before trigger": u16
  "synchronization settings": T8 = {"maximal normalization threshold"=65536, "peak timing metric threshold"=0.5, "consecutive samples over threshold"=10, "valley timing metric threshold"=-0.5, "consecutive samples under threshold"=10, "autocorelation threshold"=0.5, "expected peak valley distance"=608, "maximum peak valley distance deviation"=64, "samples to shift frame start"=-32, "use static CFO?"=FALSE, "static CFO"=0}
  "trigger condition": T9 = "Immediate"
  "manual trigger": bool
  "AGC tresholds": T10
  "AGC timeout": i32 = 3500
  "enable AGC": bool
  "manual PhyTxStart.req": cluster{"TX vector": T11, "Valid": bool}
  "bypass MAC TX": bool
  "RX TX turnaround time": u32 = 24
  "reset MAC TX statistics": bool
  "suppress ACK": bool
  "backoff value": u16
  "ACK bandwidth": enum{"20 MHz", "40 MHz", "80 MHz"} = "20 MHz"
  "rx.reset": bool = TRUE
  "rx.output sample rate": UFXP(1.47)
  "rx.delay": FXP(0.16)
  "rx 0.frequency shift": FXP(0.48)
  "rx 0.phase": FXP(0.21)
  "rx 0.impairments": T13 = {"inline gain I"=-1, "inline gain Q"=0.999992370605, "cross gain I"=0.999992370605, "cross gain Q"=0, "pre-gain offset I"=0, "pre-gain offset Q"=-1, "post-gain offset I"=0, "post-gain offset Q"=0.999992370605}
  "rx.abort": bool
  "tx.abort": bool
  "tx.reset": bool = TRUE
  "tx.input sample rate": UFXP(1.47)
  "tx.delay": FXP(0.18)
  "tx 0.frequency shift": FXP(0.48)
  "tx 0.phase": FXP(0.21)
  "tx 0.impairments": T13 = {"inline gain I"=0.999992370605, "inline gain Q"=0.999992370605, "post-gain offset I"=0.999992370605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}
  "tx 0.gain": T14 = {"gain I"=1, "gain Q"=1}
  "rx 1.impairments": T13 = {"inline gain I"=-0.999992370605, "inline gain Q"=0.999992370605, "cross gain I"=-0.999992370605, "cross gain Q"=0, "pre-gain offset I"=-1, "pre-gain offset Q"=0, "post-gain offset I"=0, "post-gain offset Q"=0}
  "rx 1.frequency shift": FXP(0.48)
  "rx 1.phase": FXP(0.21)
  "tx 1.impairments": T13 = {"inline gain I"=0.999992370605, "inline gain Q"=0.999992370605, "post-gain offset I"=-1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}
  "tx 1.frequency shift": FXP(0.48)
  "tx 1.phase": FXP(0.21)
  "tx 1.gain": T14 = {"gain I"=1, "gain Q"=1}
  "rx 0.stream enable": bool
  "rx 1.stream enable": bool
  "tx 0.stream enable": bool
  "tx 1.stream enable": bool
  "Data clock cycles per tick (0.1us)": u16 = 20
  "Data clock cycles per OFDM symbol": u16 = 480
  "rx.rf channel": UFXP(1.0)
  "tx.rf channel": UFXP(1.0)
  "enable DC offset correction": bool = TRUE
  "data clock locked?": bool
  "format": enum{"a", "ac"} = "a"
  "channel selector": UFXP(2.0)
  "device MAC address": u8[6]
  "DC centered signal": bool = TRUE
  "daughterboard": "niUsrpRio Config v1 Host.lvlib__DB Types.gtype" = "sbx"
  "antenna configuration": "niUsrpRio Config v1 Host.lvlib__Antenna Configuration.gtype" = "TX1 RX1 transmits and RX2 receives"
  "spi address": u8 = 7
  "cpld enable": bool = TRUE
panel indicators:
  "reg.notify host.go 0": bool
  "reg.host read.data 0": cluster{"go": bool, "data": u32}
  "compensated CFO": FXP(0.48)
  "MAC RX statistics": T4
  "PhyRxStart.ind": T5
  "PhyRxEnd.ind": T6
  "T2H RX Data overflow": u16
  "T2H Constallation overflow": u16
  "T2H RX Bit Processing Output FIFO overflow": u16
  "T2H RX Power Spectrum overflow": u16
  "T2H Channel Estimation overflow": u16
  "last applied gain": UFXP(5.1)
  "RF input power at packet start": FXP(10.3)
  "signal power at packet start": FXP(10.3)
  "RF input power": FXP(10.3)
  "signal power": FXP(10.3)
  "out of range?": bool
  "MAC TX statistics": T12
  "PhyTxStart.req": cluster{"TX vector": T11, "Valid": bool}
  "PhyTxEnd.ind": cluster{"Valid": bool}
  "internal loopback FIFO overflow": u16
  "TX to RF FIFO overflow": u16
  "T2H TX Baseband FIFO overflow": u16
  "T2H TX Bit Processing Output FIFO overflow": u16
  "rx.samples processed": u32
  "rx.number of IQ data overflows": u64
  "rx.number of overflows": u32
  "tx.samples processed": u32
  "tx.underflows": u32
  "tx.number of IQ data overflows": u64
  "rx.dsp reset done": bool
  "tx.dsp reset done": bool
  "tx.state": "Stream Control State.gtype"
  "rx.state": "Stream Control State.gtype"
  "Timestamp": u32
  "DC average": CFXP(1.17)
types:
  T1 = enum{"Identification", "Board Config", "Global Config", "Radio 0 Config", "Radio 1 Config", "Synchronization", "Time", "Future Events"}
  T2 = cluster{"power enable": bool, "mixer enable": bool, "gain": u8}
  T3 = enum{"RF", "BB Data From Host", "Internal Loopback"}
  T4 = cluster{"number of frames detected": u32, "number of subframes received": u32, "number of valid subframes received": u32, "number of ACKs received": u32, "valid": bool}
  T5 = cluster{"Format": enum{"a", "ac"}, "Bandwidth": enum{"20 MHz", "40 MHz", "80 MHz"}, "PSDU Length": u32, "MCS": UFXP(4.0), "valid": bool}
  T6 = cluster{"Format Violation": bool, "Timing valid": bool, "Timing value": u32, "valid": bool}
  T7 = cluster{"remove header": bool, "block unsupported frame types": bool, "block FCS errors": bool, "block address mismatch": bool, "block header recognize error": bool}
  T8 = cluster{"maximal normalization threshold": UFXP(19.15), "peak timing metric threshold": FXP(2.6), "consecutive samples over threshold": u8, "valley timing metric threshold": FXP(2.6), "consecutive samples under threshold": u8, "autocorelation threshold": UFXP(2.14), "expected peak valley distance": u16, "maximum peak valley distance deviation": u8, "samples to shift frame start": i8, "use static CFO?": bool, "static CFO": FXP(0.48)}
  T9 = enum{"Immediate", "RX Packet Start", "TX Paket Start", "CCA energy detected"}
  T10 = cluster{"AGC active threshold": FXP(10.3), "AGC threshold 1": FXP(10.3), "AGC threshold 2": FXP(10.3), "AGC threshold 3": FXP(10.3)}
  T11 = cluster{"format": enum{"a", "ac"}, "bandwidth": enum{"20 MHz", "40 MHz", "80 MHz"}, "length": u32, "MCS": UFXP(4.0), "TX power level": UFXP(4.0), "Scrambler seed": UFXP(7.0)}
  T12 = cluster{"number of TX after SIFS requests detected": u32, "number of TX after SIFS requests completed": u32, "number of TX after backoff requests detected": u32, "number of TX after backoff requests completed": u32}
  T13 = cluster{"inline gain I": FXP(1.17), "inline gain Q": FXP(1.17), "cross gain I": FXP(1.17), "cross gain Q": FXP(1.17), "pre-gain offset I": FXP(1.17), "pre-gain offset Q": FXP(1.17), "post-gain offset I": FXP(1.17), "post-gain offset Q": FXP(1.17)}
  T14 = cluster{"gain I": FXP(3.21), "gain Q": FXP(3.21)}
  "Stream Control State.gtype" = enum{"Idle", "Active"}
  "niUsrpRio Config v1 Host.lvlib__DB Types.gtype" = enum{"sbx", "cbx", "wbx", "unknown", "ubx"}
  "niUsrpRio Config v1 Host.lvlib__Antenna Configuration.gtype" = enum{"TX1 RX1 transmits and RX2 receives", "TX1 RX1 receives and RX2 is unused"}
  T15 = cluster{"MPDU subtype": enum{"ACK"}, "destination MAC address": u8[6], "valid": bool}
  T16 = cluster{"CCA energy detection busy": u8, "CCA signal detection busy": bool, "frame timing valid": bool, "frame timing value": u32, "frame timing use DIFS": bool}
  T17 = cluster{"5 MHz": bool, "10 MHz": bool, "20 MHz": bool, "40 MHz": bool, "80 Mhz": bool, "160 MHz": bool}
  T18 = cluster{"format": enum{"a", "ac"}, "channel selector": UFXP(2.0), "device MAC address": u8[6], "DC centered signal": bool, "supported bandwidths": T17}
  T19 = cluster{"global timestamp": RegisterDataType<u32>, "OFDM symbol pulse": RegisterDataType<bool>, "TX active": RegisterDataType<bool>, "channel state indication": RegisterDataType<T16>, "MPDU generation request": RegisterDataType<T15>, "shared properties": RegisterDataType<T18>}
  T20 = cluster{"CCA energy detection busy": u8, "CCA signal detection busy": bool}
  T21 = enum{"Idle", "Wait for second measurement", "AGC active", "Gain locked"}
  T22 = cluster{"trigger gain setting": bool, "gain": UFXP(5.1)}
  "802.11 PHY-SAP.gtype" = cluster{"PSDU (RX)": any, "PSDU (TX)": any, "CCA detection": RegisterDataType<T20>, "PhyRxStart.req": HandshakeDataType<T5>, "PhyRxEnd.ind": HandshakeDataType<T6>, "channel state indication": HandshakeDataType<T16>, "PhyTxStart.req": HandshakeDataType<cluster{"TX vector": T11, "Valid": bool}>, "PhyTxEnd.ind": HandshakeDataType<cluster{"Valid": bool}>, "PHY RX AGC state indication": HandshakeDataType<cluster{"AGC state": T21, "AGC enabled": bool}>, "PHY RX Gain change indication": HandshakeDataType<T22>}
  "H2T TX Data FIFOs.gtype" = cluster{"H2T TX Data 0": any, "H2T TX Data 1": any, "H2T TX Data 2": any, "H2T TX Data 3": any, "H2T TX Data 4": any}
  T23 = cluster{"RF to RX FIFO": any, "internal loopback FIFO": any, "TX to RF FIFO": any, "Gain Settings FIFO": any}
  T24 = cluster{"output sample rate": UFXP(1.47), "delay": FXP(0.16), "frequency shift": FXP(0.48), "impairments": T13, "phase": FXP(0.21)}
  T25 = cluster{"frequency shift": FXP(0.48), "impairments": T13, "phase": FXP(0.21), "input sample rate": UFXP(1.47), "gain": T14, "delay": FXP(0.18)}
diagram:
  Register Create(initial value=0) -> (reference out=w1)
  Register Create(initial value=FALSE) -> (reference out=w2)
  w3 = T15 {"MPDU subtype"="ACK", "destination MAC address"=[0, 0, 0, 0, 0, 0], "valid"=FALSE}
  Register Create(initial value=w3) -> (reference out=w4)
  Register Create(initial value=FALSE) -> (reference out=w5)
  Register Create(initial value=T16 {all zero or empty}) -> (reference out=w6)
  w7 = T18 {"format"="a", "channel selector"=0, "device MAC address"=[0, 0, 0, 0, 0, 0], "DC centered signal"=FALSE, "supported bandwidths"={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}}
  Register Create(initial value=w7) -> (reference out=w8)
  Property Node(instance in=T19 {all zero or empty}, "global timestamp"=w1, "MPDU generation request"=w4, "channel state indication"=w6, "TX active"=w5, "OFDM symbol pulse"=w2, "shared properties"=w8) -> (instance out=w9)
  FIFO Create(data type=u8 0) -> (reference out=w10)
  FIFO Create(data type=u8 0) -> (reference out=w11)
  Register Create(initial value=T20 {all zero or empty}) -> (reference out=w12)
  Handshake Create(data type=T5 {all zero or empty}) -> (reference out=w13)
  Handshake Create(data type=T6 {all zero or empty}) -> (reference out=w14)
  Handshake Create(data type=T16 {all zero or empty}) -> (reference out=w15)
  Handshake Create(data type=cluster{"TX vector": T11, "Valid": bool} {all zero or empty}) -> (reference out=w16)
  Handshake Create(data type=cluster{"Valid": bool} {all zero or empty}) -> (reference out=w17)
  w18 = cluster{"AGC state": T21, "AGC enabled": bool} {all zero or empty}
  Handshake Create(data type=w18) -> (reference out=w19)
  Handshake Create(data type=T22 {all zero or empty}) -> (reference out=w20)
  Property Node(instance in="802.11 PHY-SAP.gtype" {all zero or empty}, "PSDU (RX)"=w10, "PSDU (TX)"=w11, "CCA detection"=w12, "PhyRxStart.req"=w13, "PhyRxEnd.ind"=w14, "channel state indication"=w15, "PhyTxStart.req"=w16, "PhyTxEnd.ind"=w17, "PHY RX AGC state indication"=w19, "PHY RX Gain change indication"=w20) -> (instance out=w21)
  clock-driven loop (clock = "802.11 AFW Resources.grsc\\MAC") forever {
    call "802.11 PHY-SAP Read MAC.gcdl"(PHY-SAP=w21) -> (CCA detection=w22, PSDU=w23, PSDU valid=w24, PhyRxStart.req=w25, PhyTxEnd.ind=w26, PhyRxEnd.ind=w27, PHY RX AGC state indication=w28, PHY RX Gain change indication=w29)
    Property Node(instance in=w25) -> ("valid"=w30)
    Feedback Node(enable?=w30, initial value=u8[6] default, input=w31) -> w32
    call "802.11 MAC RX.gcdl"(PSDU=w23, input valid=w24, PHY RX start indication=w25, PHY RX end indication=w27, PHY CCA timing indication=w22, reset MAC RX statistics=$"reset MAC RX statistics", device MAC address=w32, MPDU filter config=$"MPDU filter config") -> (MAC RX statistics=w33, channel state indication=w34, ICP SDU=w35, output valid=w36, MPDU generation request=w37)
    call "802.11 RX Data Sink.gcdl"(ICP SDU=w35, input valid=w36, FIFO reference="802.11 AFW Resources.grsc\\T2H RX Data") -> (FIFO overflow count=w38)
    $"T2H RX Data overflow" <- w38
    w39 = "H2T TX Data FIFOs.gtype" {"H2T TX Data 0"="802.11 AFW Resources.grsc\\H2T TX Data 0", "H2T TX Data 1"="802.11 AFW Resources.grsc\\H2T TX Data 1", "H2T TX Data 2"="802.11 AFW Resources.grsc\\H2T TX Data 2", "H2T TX Data 3"="802.11 AFW Resources.grsc\\H2T TX Data 3", "H2T TX Data 4"="802.11 AFW Resources.grsc\\H2T TX Data 4"}
    Feedback Node(input=w40) -> w41
    call "FPGA MAC Scheduler.gcdl"(Force manual ID=FALSE, Number of TX FIFOs=5, H2T TX Data Queues=w39, Ready for scheduling=w41) -> (H2T TX Data=w42)
    Property Node(instance in=w9) -> ("shared properties"=w43, "global timestamp"=w44, "channel state indication"=w45)
    Register Read(reference in=w44) -> (data=w46)
    # w47: channel state indication
    Register Write(data=w34, reference in=w45) -> (reference out=w47)
    # w46: global time reference
    Register Read(reference in=w47) -> (data=w48)
    Register Read(reference in=w43) -> (data=w49)
    Property Node(instance in=w49) -> ("format"=w50, "device MAC address"=w31)
    # w37: MPDU request
    Feedback Node(input=w51) -> w52
    call "802.11 Prepare ACK.gcdl"(format=w50, bandwidth=$"ACK bandwidth", MPDU generation request=w37, MAC ready=w52, suppress=$"suppress ACK") -> (MPDU block=w53, output valid=w54, TX after SIFS request=w55)
    call "802.11 TX Data Source.gcdl"(ready for output=w41, H2T TX Data=w42, bypass MAC TX=$"bypass MAC TX") -> (ICP data=w56, output valid=w57, elements available=w58)
    Feedback Node(input=w59) -> w60
    Feedback Node(input=w61) -> w62
    call "802.11 Prepare MPDU.gcdl"(ICP=w56, input valid=w57, elements available=w58, MAC ready for input=w60, TX status indication=w62, backoff value=$"backoff value") -> (MPDU block=w63, ready for input=w40, output valid=w64, TX after backoff request=w65)
    Logical Or(w53, w63) -> w66
    Logical Or(w54, w64) -> w67
    Feedback Node(input=w68) -> w69
    call "802.11 MAC TX.gcdl"(TX after backoff request=w65, TX after SIFS request=w55, channel state indication=w48, global clock value=w46, RX TX turnaround time in global clock ticks=$"RX TX turnaround time", PSDU data ready for input=w69, PHY TX end indication=w26, MPDU block=w66, input valid=w67, reset MAC TX statistics=$"reset MAC TX statistics") -> (MPDU=w70, output valid=w71, PHY TX start request=w72, TX after SIFS data ready for input=w51, TX after backoff data ready for input=w59, TX status indication=w61, MAC TX statistics=w73)
    call "802.11 TX MAC Bypass.gcdl"(ready for output=w69, TX data FIFO reference=w42, bypass MAC TX=$"bypass MAC TX", manual PhyTxStart.req=$"manual PhyTxStart.req", MPDU=w70, input valid=w71, request in=w72) -> (PSDU=w74, output valid=w75, request out=w76)
    call "802.11 PHY-SAP Write MAC.gcdl"(PHY-SAP=w21, PhyTxStart.req=w76, PSDU=w74, PSDU valid=w75, channel state indication=w34) -> (PSDU TX ready for input=w68)
    $"MAC RX statistics" <- w33
    call "802.11 Write RX Events.gcdl"(global timestamp=w46, PHY RX start indication=w25, PHY RX end indication=w27, MAC channel state indication=w34, PHY CCA timing indication=w22, T2H FIFO reference="802.11 AFW Resources.grsc\\T2H Events", PHY RX Gain change indication=w29, PHY RX AGC state indication=w28)
    $"MAC TX statistics" <- w73
    call "802.11 Capture PHY TX Indications.gcdl"(PHY TX end indication in=w26, PHY TX start request in=w76) -> (PHY TX start request out=w77, PHY TX end indication out=w78)
    $"PhyTxStart.req" <- w77
    $"PhyTxEnd.ind" <- w78
    call "802.11 Write TX Events.gcdl"(global time reference=w46, PHY TX end indication=w26, PHY TX start request=w76, TX status indication=w61, T2H FIFO reference="802.11 AFW Resources.grsc\\T2H Events")
  }
  FIFO Create(data type=CFXP(3.13) 0+0i, depth=17) -> (reference out=w79)
  FIFO Create(data type=CFXP(3.13) 0+0i, depth=1025) -> (reference out=w80)
  FIFO Create(data type=CFXP(3.13) 0+0i, depth=1025) -> (reference out=w81)
  FIFO Create(data type=UFXP(5.1) 0, depth=17) -> (reference out=w82)
  Property Node(instance in=T23 {all zero or empty}, "RF to RX FIFO"=w79, "internal loopback FIFO"=w80, "TX to RF FIFO"=w81, "Gain Settings FIFO"=w82) -> (instance out=w83)
  clock-driven loop (clock = "802.11 AFW Resources.grsc\\PHY") forever {
    Property Node(instance in=w9) -> ("global timestamp"=w84, "shared properties"=w85, "TX active"=w86, "OFDM symbol pulse"=w87)
    Register Read(reference in=w84) -> (data=w88)
    Property Node(instance in=w83) -> ("RF to RX FIFO"=w89, "internal loopback FIFO"=w90, "TX to RF FIFO"=w91, "Gain Settings FIFO"=w92)
    Register Read(reference in=w87) -> (data=w93, reference out=w94)
    Register Read(reference in=w85) -> (data=w95)
    # w93: Symbol trigger
    Property Node(instance in=w95) -> ("supported bandwidths"=w96, "DC centered signal"=w97, "channel selector"=w98)
    Feedback Node(input=w99) -> w100
    call "802.11 PHY-SAP Read PHY.gcdl"(PHY-SAP=w21, ready for output=w100) -> (PSDU=w101, PSDU valid=w102, PhyTxStart.req=w103)
    call "niInstr Basic Elements v1 FPGA.lvlib__Detect Rising Edge.gcdl"(signal=w93) -> (edge detected=w104)
    call "802.11 PHY TX Request Handler.gcdl"(symbol trigger in=w104, PhyTxStart.req=w103, supported bandwidths=w96) -> (symbol index=w105, symbol trigger out=w106, start of packet=w107, TX vector out=w108, PhyTxEnd.ind=w109, TX active=w110)
    Register Write(data=w110, reference in=w86) -> (reference out=w111)
    call "802.11 RX Data Source.gcdl"(RX data source=$"RX data source", mute RX while TX active?=$"mute RX while TX active?", TX active register=w111, RF to RX FIFO=w89, internal loopback FIFO=w90, OFDM symbol trigger register=w94, produce silent samples=$"produce silent samples", H2T FIFO="802.11 AFW Resources.grsc\\H2T RX Baseband") -> (sample=w112, output valid=w113)
    call "802.11 Signal Filter.gcdl"(sample in=w112, input valid=w113, configuration=w95) -> (20MHz sample out=w114, output valid=w115, 40MHz sample out=w116, 80MHz sample out=w117)
    Feedback Node(input=w118) -> w119
    call "802.11 Synchronization.gcdl"(bypass synchronization=$"bypass synchronization", rearm packet start generator=$"rearm packet start generator", packet start sample index=$"packet start sample index", synchronization settings=$"synchronization settings", rearm sychronization=w119, sample in=w112, input valid=w113, filtered sample=w114, filtered sample valid=w115) -> (sample out=w120, output valid=w121, packet start=w122, compensated CFO=w123, CCA signal detected=w124)
    w125 = T18 {"format"="a", "channel selector"=0, "device MAC address"=[0, 0, 0, 0, 0, 0], "DC centered signal"=FALSE, "supported bandwidths"={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}}
    Feedback Node(enable?=w122, initial value=w125, input=w95) -> w126
    Property Node(instance in=w126) -> ("format"=w127, instance out=w128)
    Feedback Node(input=w129) -> w130
    call "802.11 RX IQ Processing.gcdl"(sample=w120, input valid=w121, packet start=w122, configuration=w130) -> (subcarrier=w131, subcarrier timing=w132, subcarrier field map=w133, last sample received=w134, channel estimate=w135, channel estimate timing=w136)
    Feedback Node(input=w137) -> w138
    call "802.11 RX Bit Processing.gcdl"(subcarrier timing=w132, subcarrier=w131, field map=w133, configuration=w138, noise coefficient=$"noise coefficient") -> (current OFDM symbol=w139, PSDU=w140, bit=w141, bit valid=w142, last byte decoded=w143, PSDU valid=w144)
    call "802.11 RX PHY State Machine.gcdl"(bit=w141, bit valid=w142, shared properties=w128, current OFDM symbol=w139, last bit of packet decoded=w143, last sample of packet received=w134, global timestamp=w88) -> (RX bit processing configuration=w137, RX IQ processing configuration=w129, PhyRxStart.ind=w145, PhyRxEnd.ind=w146)
    Property Node(instance in=w146) -> ("valid"=w118)
    Feedback Node(input=w147) -> w148
    To Fixed Point(number=w148) -> w149: FXP(10.3) Saturate:ConvergentRounding
    Select(s=$"enable AGC", t=w149, f=$"RF gain") -> w150
    call "802.11 Power Measurement.gcdl"(sample=w117, input valid=w115, CCA energy detect threshold=$"CCA energy detect threshold", power calibration offset=$"power calibration offset", RF gain=w150, sample 20MHz filtered=w114, sample 40MHz filtered=w116) -> (signal power=w151, output valid=w152, out of range?=w153, CCA energy detect=w154, RF input power=w155)
    Property Node(instance in=T20 {all zero or empty}, "CCA energy detection busy"=w154, "CCA signal detection busy"=w124) -> (instance out=w156)
    call "802.11 AGC.gcdl"(signal power=w151, packet start=w122, rearm AGC=w119, AGC thresholds=$"AGC tresholds", AGC timeout=$"AGC timeout", signal power valid=w152, enable AGC=$"enable AGC") -> (gain=w157, trigger gain setting=w158, state=w159, last applied gain=w147)
    Property Node(instance in=T22 {all zero or empty}, "trigger gain setting"=w158, "gain"=w157) -> (instance out=w160)
    w161 = cluster{"AGC state": T21, "AGC enabled": bool} {all zero or empty}
    Property Node(instance in=w161, "AGC state"=w159, "AGC enabled"=$"enable AGC") -> (instance out=w162)
    call "802.11 PHY-SAP Write PHY.gcdl"(PHY-SAP=w21, PSDU valid=w144, PSDU=w140, CCA detection=w156, PhyRxEnd.ind=w146, PhyRxStart.ind=w145, PhyTxEnd.ind=w109, PHY RX Gain change indication=w160, PHY RX AGC state indication=w162)
    call "802.11 Prepare RX IQ Data for T2H.gcdl"(subcarrier=w131, timing=w132, field map=w133, FIFO reference="802.11 AFW Resources.grsc\\T2H Constellation") -> (FIFO overflow count=w163)
    $"T2H Constallation overflow" <- w163
    call "802.11 Prepare Channel Estimation for T2H.gcdl"(channel estimate=w135, timing=w136, format=w127, FIFO reference="802.11 AFW Resources.grsc\\T2H Channel Estimation") -> (FIFO overflow count=w164)
    $"T2H Channel Estimation overflow" <- w164
    call "802.11 Trigger Capture RX Samples.gcdl"(trigger condition=$"trigger condition", manual trigger=$"manual trigger", RX packet start=w122, TX active register=w111, CCA energy detected=w154) -> (trigger=w165)
    call "802.11 Capture RX Samples.gcdl"(sample=w120, input valid=w121, trigger=w165, number of samples to capture=$"number of samples to capture", FIFO reference="802.11 AFW Resources.grsc\\T2H RX Power Spectrum", number of samples before trigger=$"number of samples before trigger") -> (FIFO overflow count=w166)
    $"T2H RX Power Spectrum overflow" <- w166
    call "802.11 TX Bit Processing.gcdl"(symbol trigger=w106, OFDM symbol index=w105, TX vector=w108, PSDU=w101, input valid=w102) -> (bit=w167, output valid=w168, ready for input=w99, modulation=w169)
    call "802.11 TX IQ Processing.gcdl"(symbol trigger=w106, OFDM symbol index=w105, TX vector=w108, channel selector=w98, start of packet=w107, bit valid=w168, bit=w167, bit processing modulation=w169, DC centered signal=w97, supported bandwidths=w96) -> (data out=w170, output valid=w171)
    call "802.11 TX Data Sink.gcdl"(TX to RF FIFO=w91, internal loopback FIFO=w90, sample=w170, input valid=w171, T2H FIFO="802.11 AFW Resources.grsc\\T2H TX Baseband") -> (T2H FIFO overflow count=w172, TX to RF FIFO overflow count=w173, internal loopback FIFO overflow count=w174)
    $"T2H TX Baseband FIFO overflow" <- w172
    $"TX to RF FIFO overflow" <- w173
    $"compensated CFO" <- w123
    $"internal loopback FIFO overflow" <- w174
    call "802.11 RX Bit Processing Data Sink.gcdl"(PSDU=w140, input valid=w144, FIFO reference="802.11 AFW Resources.grsc\\T2H RX Bit Processing Output") -> (FIFO overflow count=w175)
    $"T2H RX Bit Processing Output FIFO overflow" <- w175
    call "802.11 TX Bit Processing Data Sink.gcdl"(bit=w167, input valid=w168, modulation=w169, FIFO reference="802.11 AFW Resources.grsc\\T2H TX Bit Processing Output") -> (FIFO overflow count=w176)
    $"T2H TX Bit Processing Output FIFO overflow" <- w176
    call "802.11 Capture PHY RX Indications.gcdl"(PHY RX start indication in=w145, PHY RX end indication in=w146) -> (PHY RX start indication out=w177, PHY RX end indication out=w178)
    $"PhyRxStart.ind" <- w177
    $"PhyRxEnd.ind" <- w178
    $"RF input power" <- w155
    Feedback Node(enable?=w122, input=w155) -> w179
    $"RF input power at packet start" <- w179
    $"signal power" <- w151
    Feedback Node(enable?=w122, input=w151) -> w180
    $"signal power at packet start" <- w180
    $"out of range?" <- w153
    FIFO Write(Control Protocol Input=w158, data=w157, reference in=w92)
    $"last applied gain" <- w147
  }
  call "Create Resources.gvi"() -> (config.resources=w181, sync.resources=w182, time.resources=w183)
  clock-driven loop (clock = "40 MHz Onboard Clock") {
    Io Write(data=$"RF 1/Rx/Enable", reference in="RF 1/Rx/Enable")
    Io Write(data=$"RF 0/Tx/Enable", reference in="RF 0/Tx/Enable")
    Io Write(data=$"RF 0/Rx/Enable", reference in="RF 0/Rx/Enable")
    Feedback Node(input=w184) -> w185
    Property Node(instance in=w83) -> ("Gain Settings FIFO"=w186)
    FIFO Read(Control Protocol Input=TRUE, reference in=w186) -> (Control Protocol Output=w184, data=w187)
    Feedback Node(enable?=w184, input=w187) -> w188
    To Fixed Point(number=w188) -> w189: UFXP(6.1) Wrap:Truncate
    # Register Bus and Required Controls/Indicators
    Scale By Power Of 2(n=1, x=w189) -> w190
    To Unsigned Byte Integer(number=w190) -> w191
    Property Node(instance in=T2 {"power enable"=TRUE, "mixer enable"=TRUE, "gain"=0}, "power enable"=$"power enable", "mixer enable"=$"mixer enable", "gain"=w191) -> (instance out=w192)
    call "Set Gain.gcdl"(ATR State=$"ATR State", Radio Control Destination=$"Radio Control Destination", FPGA.Fifo="802.11 AFW Resources.grsc\\AGC Reg Bus 0 Access FIFO", daughterboard=$daughterboard, antenna configuration=$"antenna configuration", Write ATR?=w185, lo lpf enable=$"lo lpf enable", rx.configuration=w192, tx.configuration=$"tx.configuration", spi address=$"spi address", cpld enable=$"cpld enable")
    Io Write(data=$"RF 1/Tx/Enable", reference in="RF 1/Tx/Enable")
    Feedback Node(input=w193) -> w194
    Property Node(instance in=w194) -> ("ready for port 0 input"=w195, "ready for port 1 input"=w196)
    Feedback Node(input=w197) -> w198
    call "niInstr Register Bus v1 FPGA.lvlib__Process.gcdl"(reg.notify host.go rcvd=$"reg.notify host.go rcvd 0", reg.host read.go rcvd=$"reg.host read.go rcvd 0", read completion=w198, reg.reset=$"reg.reset 0", reg.host instruction fifo="niInstr Register Bus v0.grsc\\reg.host instruction fifo 0", ready for output=w196) -> (reg.notify host.go=w199, reg.host read.data=w200, register instruction=w201)
    $"reg.notify host.go 0" <- w199
    $"reg.host read.data 0" <- w200
    FIFO Read(Control Protocol Input=w195, reference in="802.11 AFW Resources.grsc\\AGC Reg Bus 0 Access FIFO") -> (Control Protocol Output=w202, data=w203)
    call "Retrieve FPGA Scoped Instruction.gcdl"(number=w203, valid=w202) -> (output cluster=w204)
    Feedback Node(input=w205) -> w206
    call "niInstr Register Bus v1 FPGA.lvlib__Register Instruction Arbiter (2 inputs).gcdl"(port 0=w204, port 1=w201, reset=FALSE, ready for output=w206) -> (register instr out=w207, ready for input=w193)
    call "Registers.gcdl"(register instruction=w207, config.resources=w181, sync.resources=w182, time.resources=w183) -> (read completion out=w197, ready for input=w205)
    stop if FALSE
  }
  clock-driven loop (clock = "Data Clock") forever {
    # Baseband to/from RF conversion
    # Data Reception from Antenna, downconversion to baseband sample rate, received data will be written into RX baseband input FIFO
    # Reading of TX baseband FIFO, upconversion and transmission to antenna
    Property Node(instance in=w9) -> ("shared properties"=w208, "global timestamp"=w209, "OFDM symbol pulse"=w210)
    call "Mod N Indexer U16 v2.gcdl"(N=$"Data clock cycles per tick (0.1us)", enable=$"data clock locked?") -> (wrap back?=w211)
    call "niInstr Basic Elements v1 FPGA.lvlib__Count Up U32.gcdl"(increment=w211, reset=FALSE) -> (count out=w212)
    Register Write(data=w212, reference in=w209)
    call "Mod N Indexer U16 v2.gcdl"(N=$"Data clock cycles per OFDM symbol", enable=$"data clock locked?") -> (wrap back?=w213)
    Register Write(data=w213, reference in=w210)
    w214 = T17 {"5 MHz"=FALSE, "10 MHz"=FALSE, "20 MHz"=TRUE, "40 MHz"=TRUE, "80 Mhz"=FALSE, "160 MHz"=FALSE}
    w215 = T18 {"format"="a", "channel selector"=0, "device MAC address"=[0, 0, 0, 0, 0, 0], "DC centered signal"=FALSE, "supported bandwidths"={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}}
    Property Node(instance in=w215, "format"=$format, "channel selector"=$"channel selector", "device MAC address"=$"device MAC address", "DC centered signal"=$"DC centered signal", "supported bandwidths"=w214) -> (instance out=w216)
    Register Write(data=w216, reference in=w208)
    $Timestamp <- w212
    Property Node(instance in=w83) -> ("TX to RF FIFO"=w217, "RF to RX FIFO"=w218)
    Build Array($"rx 0.stream enable", $"rx 1.stream enable") -> w219
    w220 = T24 {"0x800000000000", 0, 0, "0x1FFFF", "0x1FFFF", 0, 0, 0, 0, 0, 0, 0}
    Property Node(instance in=w220, "impairments"=$"rx 0.impairments", "frequency shift"=$"rx 0.frequency shift", "phase"=$"rx 0.phase", "output sample rate"=$"rx.output sample rate", "delay"=$"rx.delay") -> (instance out=w221)
    w222 = T24 {"0x800000000000", 0, 0, "0x1FFFF", "0x1FFFF", 0, 0, 0, 0, 0, 0, 0}
    Property Node(instance in=w222, "delay"=$"rx.delay", "output sample rate"=$"rx.output sample rate", "impairments"=$"rx 1.impairments", "frequency shift"=$"rx 1.frequency shift", "phase"=$"rx 1.phase") -> (instance out=w223)
    Build Array(w221, w223) -> w224
    call "802.11 USRP Stream RX.gcdl"(RF to RX FIFO reference=w218, enable DC offset correction=$"enable DC offset correction", rx.reset=$"rx.reset", rx.rf channel=$"rx.rf channel", rx. stream enabled=w219, rx.abort=$"rx.abort", DDC parameters=w224) -> (rx.number of IQ data overflows=w225, rx.dsp reset done=w226, DC average=w227, rx.state=w228, rx.samples processed=w229, rx.number of overflows=w230)
    $"rx.number of IQ data overflows" <- w225
    Build Array($"tx 0.stream enable", $"tx 1.stream enable") -> w231
    w232 = T25 {0, "0x1FFFF", "0x1FFFF", 0, 0, 0, 0, 0, 0, 0, 0, "0x200000", "0x200000", 0}
    Property Node(instance in=w232, "gain"=$"tx 0.gain", "frequency shift"=$"tx 0.frequency shift", "phase"=$"tx 0.phase", "impairments"=$"tx 0.impairments", "input sample rate"=$"tx.input sample rate", "delay"=$"tx.delay") -> (instance out=w233)
    w234 = T25 {0, "0x1FFFF", "0x1FFFF", 0, 0, 0, 0, 0, 0, 0, 0, "0x200000", "0x200000", 0}
    Property Node(instance in=w234, "delay"=$"tx.delay", "input sample rate"=$"tx.input sample rate", "gain"=$"tx 1.gain", "frequency shift"=$"tx 1.frequency shift", "phase"=$"tx 1.phase", "impairments"=$"tx 1.impairments") -> (instance out=w235)
    Build Array(w233, w235) -> w236
    call "802.11 USRP Stream TX.gcdl"(tx.enable streams=w231, tx.reset=$"tx.reset", tx.rf channel=$"tx.rf channel", TX to RF FIFO reference=w217, tx.abort=$"tx.abort", DUC parameters=w236) -> (tx.state=w237, tx.samples processed=w238, tx.underflows=w239, tx.number of IQ data overflows=w240, tx.dsp reset done=w241)
    $"tx.state" <- w237
    $"rx.dsp reset done" <- w226
    $"tx.samples processed" <- w238
    $"rx.state" <- w228
    $"tx.underflows" <- w239
    $"rx.samples processed" <- w229
    $"tx.number of IQ data overflows" <- w240
    $"rx.number of overflows" <- w230
    $"tx.dsp reset done" <- w241
    $"DC average" <- w227
  }
  call "LEDs.gvi"()
  call "niUsrpRio Config v1 FPGA.lvlib__Process.gvi"(resources=w181)
